# Grasshopper definition XX_00_topologizer.gh (Grasshopper 0.9.76)
# Copyright: Co-de-iT

panel = Panel("curves network")
# Topologizer
# 
# Find unique points and connections for a line network
# 
# © a3 2017 _ Creative Commons Attribution-NonCommercial-ShareAlike3.0 UnportedLicense.
crv = Curve([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])
preview = CustomPreview(
    Geometry=crv,
    Shader={ambient=RGB(0, 0, 0), diffuse=RGB(255, 105, 180), emission=RGB(76, 32, 54), shine=0.5, specular=RGB(255, 255, 255), transparency=0})

end = EndPoints(Curve=crv)  # -> Start, End
merge = Merge(Data1=end.Start, Data2=end.End)  # -> flatten(Result)
cset = CreateSet(List=merge)  # -> Set, Map
mindex = MemberIndex(Set=cset.Set, Member=end.Start)  # -> Index, Count
# find topological connections
# (GH method by Alessio Erioli)
mindex_2 = MemberIndex(Set=cset.Set, Member=end.End)  # -> Index, Count

expression = Expression(x=mindex.Index, y=mindex_2.Index, Expression="Format(\"{0}-{1}\",int(x), int(y))")  # -> flatten(R)
item = ListItem(List=cset.Set, Index=mindex.Index, Wrap=True)
item_2 = ListItem(List=cset.Set, Index=mindex_2.Index, Wrap=True)
lng = ListLength(List=cset.Set)
avr = Average(Input=[item, item_2])  # -> flatten(ArithmeticMean)
series = Series(Start=0, Step=1, Count=lng)
int = Integer(series)
# point tags
tag = TextTag3D(
    Location=cset.Set,
    Text=int,
    Size=Slider(3.201, range=0..5),
    Colour=ColourSwatch(SwatchColor=RGB(255, 255, 255)),
    Justification=7)
# connection tags
tag_2 = TextTag3D(
    Location=avr,
    Text=expression,
    Size=Slider(2, range=0..5),
    Colour=ColourSwatch(SwatchColor=RGB(8, 8, 8)),
    Justification=7)
